# Grasshopper definition UC-3.gh (Grasshopper 1.0.7)

range = Range(Domain=Slider(5, range=0..10), Steps=Slider(5, range=0..10))
graph = GraphMapper(
    range,
    x0=0,
    x1=5,
    y0=0,
    y1=5,
    container_name="Bezier",
    cpx=[0, 0.5944334269, 0.952286303, 1],
    cpy=[0, 0.4010282755, 0.4010282755, 1])

range_2 = Range(Domain=Slider(5, range=0..10), Steps=Slider(5, range=0..10))

range_3 = Range(Domain=Slider(10, range=0..10), Steps=Slider(5, range=0..10))

pt = ConstructPoint(XCoordinate=range_2, YCoordinate=graph, ZCoordinate=range_3)
panel = Panel(graph)
panel_2 = Panel(pt)
nurbs = NurbsCurve(Vertices=pt, Degree=3, Periodic=False)  # -> Curve, Length, Domain
cluster = Cluster(C=nurbs.Curve)  # -> E, G, G_2
geo = Geometry([cluster.E, cluster.G, cluster.G_2])

box = Box2Pt(PointA=Point(0, 0, 0), PointB=Point(10, 10, 10), Plane=PlaneXY(0, 0, 0))
sdiff = SolidDifference(BrepsA=box, BrepsB=geo)
sdiff_2 = SolidDifference(BrepsA=box, BrepsB=sdiff)

scale_nu = ScaleNU(Geometry=sdiff_2, Plane=PlaneXY(0, 0, 0), ScaleX=1, ScaleY=1, ScaleZ=0.5)  # -> Geometry, Transform
mirror = Mirror(Geometry=scale_nu.Geometry, Plane=PlaneXY(5, 0, 5))  # -> Geometry, Transform

sunion = SolidUnion(Breps=[scale_nu.Geometry, mirror.Geometry])
porosity = Porosity(G=box, G_2=sunion)
preview = CustomPreview(Geometry=sunion, Material=ColourSwatch(SwatchColor=RGB(59, 100, 255)))
panel_3 = Panel(porosity)

area = Area(Geometry=sunion)  # -> Area, Centroid
panel_4 = Panel(area.Area)

# ==== cluster Porosity
G = ClusterInput()
G_2 = ClusterInput()
volume = Volume(Geometry=G)  # -> Volume, Centroid
volume_2 = Volume(Geometry=G_2)  # -> Volume, Centroid
subtraction = Subtraction(A=volume.Volume, B=volume_2.Volume)
division = Division(A=subtraction, B=volume.Volume)
multiplication = Multiplication(A=division, B=100)
R = ClusterOutput(multiplication)

# ==== cluster Cluster
circle = CircleCNR(Center=Point(0, 0, 0), Normal=Vector(0, 0, 1), Radius=Slider(1.2, range=0..10))
C = ClusterInput()
pl_3pt = Plane3Pt(PointA=Point(5, 5, 10), PointB=Point(0, 5, 10), PointC=Point(0, 5, 0))
extrcrv = ExtrudeAlong(Base=circle, Curve=C)
E = ClusterOutput(extrcrv)
mirror = Mirror(Geometry=extrcrv, Plane=pl_3pt)  # -> Geometry, Transform
G = ClusterOutput(mirror.Geometry)
pl_3pt_2 = Plane3Pt(PointA=Point(5, 5, 10), PointB=Point(5, 0, 10), PointC=Point(5, 0, 0))
mirror_2 = Mirror(Geometry=[mirror.Geometry, extrcrv], Plane=pl_3pt_2)  # -> Geometry, Transform
G_2 = ClusterOutput(mirror_2.Geometry)
