# Grasshopper definition UC-1.gh (Grasshopper 1.0.7)

number_slider = Slider(5.5, range=0..10)
number_slider_2 = Slider(2.7, range=0..10)
pl_3pt = Plane3Pt(PointA=Point(5, 5, 5), PointB=Point(10, 5, 5), PointC=Point(5, 10, 5))
pl_3pt_2 = Plane3Pt(PointA=Point(5, 5, 5), PointB=Point(5, 5, 10), PointC=Point(5, 10, 5))
pl_3pt_3 = Plane3Pt(PointA=Point(5, 5, 5), PointB=Point(10, 5, 5), PointC=Point(5, 5, 10))
cir = Circle(Plane=pl_3pt, Radius=number_slider)
cir_2 = Circle(Plane=pl_3pt_2, Radius=number_slider)
cir_3 = Circle(Plane=pl_3pt_3, Radius=number_slider)
P = Plane(PlaneXY(0, 0, 0))
pipe = Pipe(Curve=cir, Radius=number_slider_2, Caps=0)
pipe_2 = Pipe(Curve=cir_2, Radius=number_slider_2, Caps=0)
box = Box2Pt(PointA=Point(0, 0, 0), PointB=Point(10, 10, 10), Plane=P)
pipe_3 = Pipe(Curve=cir_3, Radius=number_slider_2, Caps=0)
sdiff = SolidDifference(BrepsA=box, BrepsB=[pipe, pipe_2, pipe_3])
sunion = SolidUnion(Breps=sdiff)
preview = CustomPreview(Geometry=sunion, Material=ColourSwatch(SwatchColor=RGB(78, 117, 255)))
